# Grasshopper definition tool_2023.gh (Grasshopper 1.0.7)

panel = Panel("""0
10
10
10
10
10
10
12
10
10
10
10
10
10""")
panel_2 = Panel("""0
10
15
22
20
15
20
20
15""")
ext_insulation_thickness_in = Slider(5, range=0..12)
line = Line(Line((0, 0, 0), (1, 0, 0)))
line_2 = Line(Line((0, 0, 0), (0, 1, 0)))
pt = Point(Point(0, 0, 0))
int_insulation = ValueList({"Fiberglass", "Cellulose", "None"}, selected="None")
interior_finish = ValueList({"Gyp", "None"}, selected="Gyp")
ext_insulation = ValueList({"EPS", "Polyiso", "Rockwool"}, selected="Polyiso")
city = ValueList({"Seattle", "Los Angeles", "San Antonio", "Atlanta", "Milwaukee", "New York"}, selected="Atlanta")
# Wall Construction
# Options
facade_cladding = ValueList({"Brick", "Fiber Cement", "Metal Panel": "Steel Panel", "Wood"}, selected="Metal Panel")
exterior_wall_framing = ValueList({"2x4 Wood Studs", "2x6 Wood Studs", "2x8 Wood Studs", "2x10 Wood Studs", "2x12 Wood Studs"}, selected="2x12 Wood Studs")
run_energy_model = BooleanToggle(False)
folder_to_save_simulations = Panel("")
west_horizontal_shades = Slider(2, range=0..10)
exterior_automated_shades_east = BooleanToggle(False)
north_horizontal_shades = Slider(2, range=0..10)
east_horizontal_shades = Slider(2, range=0..10)
south_horizontal_shades = Slider(2, range=0..10)
# Automated Exterior Shading Options
exterior_automated_shades_north = BooleanToggle(False)
exterior_automated_shades_south = BooleanToggle(False)
# Horizontal Shading Options
north_horizontal_shade_depth_ft = Slider(2, range=0..10)
east_horizontal_shade_depth_ft = Slider(2, range=0..10)
south_horizontal_shade_depth_ft = Slider(2, range=0..10)
west_horizontal_shade_depth = Slider(2, range=0..10)
exterior_automated_shades_west = BooleanToggle(False)
shgc_west_windows = Slider(0.8, range=0.1..0.8)
shgc_south_windows = Slider(0.35, range=0.1..0.8)
shgc_east_windows = Slider(0.35, range=0.1..0.8)
# Vertical Shading Options
north_vertical_shade_depth_ft = Slider(2, range=0..10)
east_vertical_shade_depth_ft = Slider(2, range=0..10)
south_vertical_shade_depth_ft = Slider(2, range=0..10)
west_vertical_shade_depth_ft = Slider(2, range=0..10)
shgc_north_windows = Slider(0.35, range=0.1..0.8)
of_north_vertical_shades = Slider(2, range=0..10)
of_east_vertical_shades = Slider(3, range=0..10)
of_south_vertical_shades = Slider(0, range=0..10)
of_west_vertical_shades = Slider(2, range=0..10)
# Window Properties
glazing_type = ValueList({"Double": "double", "Triple": "triple"}, selected="Double")
floor_adiabatic = BooleanToggle(True)
# Roof & Floor
# Conditions
roof_adiabatic = BooleanToggle(True)
# WWR
north_wwr = Slider(0.2, range=0.1..0.9)
east_wwr = Slider(0.3, range=0.1..0.9)
south_wwr = Slider(0.4, range=0.1..0.9)
west_wwr = Slider(0.6, range=0.1..0.9)
make_grid = GhPythonScript(
    sp=pt,
    span_x=panel,
    span_y=panel_2,
    xaxis=line,
    yaxis=line_2,
    height=Slider(13, range=0..20),
    core=[Slider(1, range=0..10), Slider(1, range=0..10)])  # -> out, columns, beams_x, beams_y, cores; inputs span_x: list, span_y: list, core: list of Int32
# ---------- make_grid: Python ----------
import rhinoscriptsyntax as rs

from carbon_tool.functions import make_structure
reload(make_structure)
from carbon_tool.functions.make_structure import make_grid_structure


columns, beams_x, beams_y, cores = make_grid_structure(sp,
                                                       span_x,
                                                       span_y,
                                                       xaxis,
                                                       yaxis,
                                                       height,
                                                       core)
# ---------- end make_grid ----------
# Exterior Shading Devices
# (not sure if we want to include this)
exterior_shades_brep = Brep([<brep referenced from the Rhino model> x3])
# Zone Names
panel_3 = Panel("""zone_1
zone_2""")
# Inputs required
# for operational energy
# simulation
# Zone Geometry
brep = Brep([<brep referenced from the Rhino model> x2])
crv = Curve(<curve referenced from the Rhino model>)
num_floors_above = Slider(18, range=0..18)
trim_grid = GhPythonScript(polyline=crv, columns=make_grid.columns, beams_x=make_grid.beams_x, beams_y=make_grid.beams_y, cores=make_grid.cores)  # -> out, columns, beams_x, beams_y, cores; inputs polyline: list, columns: list, beams_x: list, beams_y: list, cores: list
# ---------- trim_grid: Python ----------
import rhinoscriptsyntax as rs

from carbon_tool.functions import make_structure
reload(make_structure)
from carbon_tool.functions.make_structure import trim_structure


columns, beams_x, beams_y, cores = trim_structure(polyline,
                                                  columns,
                                                  beams_x,
                                                  beams_y,
                                                  cores)
# ---------- end trim_grid ----------
building_type = ValueList({"Type 3", "Type 4A", "Type 4B", "Type 4C", "Type 5"}, selected="Type 4B")
composite_slab = BooleanToggle(False)
beams_x = Curve(trim_grid.beams_x)
beams_y = Curve(trim_grid.beams_y)
columns = Curve(trim_grid.columns)
cores = Curve(trim_grid.cores)
columns_2 = Curve(flatten(columns))
beams_x_2 = Curve(flatten(beams_x))
core = Curve(flatten(cores))
beams_y_2 = Curve(flatten(beams_y))
building = GhPythonScript(
    zone_breps=brep,
    znames=panel_3,
    is_roof_adiabatic=roof_adiabatic,
    is_floor_adiabatic=floor_adiabatic,
    north_wwr=north_wwr,
    east_wwr=east_wwr,
    south_wwr=south_wwr,
    west_wwr=west_wwr,
    north_horizontal_shade_depth=north_horizontal_shade_depth_ft,
    east_horizontal_shade_depth=east_horizontal_shade_depth_ft,
    south_horizontal_shade_depth=south_horizontal_shade_depth_ft,
    west_horizontal_shade_depth=west_horizontal_shade_depth,
    north_horizontal_num_shades=north_horizontal_shades,
    east_horizontal_num_shades=east_horizontal_shades,
    south_horizontal_num_shades=south_horizontal_shades,
    west_horizontal_num_shades=west_horizontal_shades,
    north_vertical_shade_depth=north_vertical_shade_depth_ft,
    east_vertical_shade_depth=east_vertical_shade_depth_ft,
    south_vertical_shade_depth=south_vertical_shade_depth_ft,
    west_vertical_shade_depth=west_vertical_shade_depth_ft,
    north_vertical_num_shades=of_north_vertical_shades,
    east_vertical_num_shades=of_east_vertical_shades,
    south_vertical_num_shades=of_south_vertical_shades,
    west_vertical_num_shades=of_west_vertical_shades,
    north_automated_shades=exterior_automated_shades_north,
    east_automated_shades=exterior_automated_shades_east,
    south_automated_shades=exterior_automated_shades_south,
    west_automated_shades=exterior_automated_shades_west,
    glazing_type=glazing_type,
    shgc_n=shgc_north_windows,
    shgc_e=shgc_east_windows,
    shgc_s=shgc_south_windows,
    shgc_w=shgc_west_windows,
    custom_shades=exterior_shades_brep,
    cladding=facade_cladding,
    exterior_insulation_material=ext_insulation,
    exterior_insulation_thickness=ext_insulation_thickness_in,
    interior_insulation_material=int_insulation,
    exterior_wall_framing=exterior_wall_framing,
    interior_finish=interior_finish,
    city=city,
    out_path=folder_to_save_simulations,
    run_model=run_energy_model,
    building_type=building_type,
    num_floors_above=num_floors_above,
    composite_slab=composite_slab,
    columns=columns_2,
    beams_x=beams_x_2,
    beams_y=beams_y_2,
    cores=core)  # -> out, building; inputs zone_breps: list, znames: list, custom_shades: list, columns: list, beams_x: list, beams_y: list, cores: list
# ---------- building: Python ----------
import rhinoscriptsyntax as rs

from carbon_tool.datastructures import building
reload(building)
from carbon_tool.datastructures.building import Building

wwrs = {'north': north_wwr,
        'east': east_wwr,
        'south':south_wwr,
        'west': west_wwr}

shades = {'north':{'horizontal':{'depth': north_horizontal_shade_depth,
                                 'num'  : north_horizontal_num_shades},
                   'vertical':{'depth': north_vertical_shade_depth,
                                 'num'  : north_vertical_num_shades}},
          'east':{'horizontal':{'depth': east_horizontal_shade_depth,
                                 'num'  : east_horizontal_num_shades},
                   'vertical':{'depth': east_vertical_shade_depth,
                                 'num'  : east_vertical_num_shades}},                    
          'south':{'horizontal':{'depth': south_horizontal_shade_depth,
                                 'num'  : south_horizontal_num_shades},
                   'vertical':{'depth': south_vertical_shade_depth,
                                 'num'  : south_vertical_num_shades}},                       
          'west':{'horizontal':{'depth': west_horizontal_shade_depth,
                                 'num'  : west_horizontal_num_shades},
                   'vertical':{'depth': west_vertical_shade_depth,
                                 'num'  : west_vertical_num_shades}}}

automated_shades = {'north': north_automated_shades,
                    'east': east_automated_shades,
                    'south': south_automated_shades,
                    'west': west_automated_shades}

shgc = {'north': shgc_n,'east': shgc_e,'south': shgc_s,'west': shgc_w}

columns = [[list(rs.CurveStartPoint(col)), list(rs.CurveEndPoint(col))] for col in columns]
beams_x = [[list(rs.CurveStartPoint(beam)), list(rs.CurveEndPoint(beam))] for beam in beams_x]
beams_y = [[list(rs.CurveStartPoint(beam)), list(rs.CurveEndPoint(beam))] for beam in beams_y]
cores = [rs.PolylineVertices(core) for core in cores]


building = Building.from_gh(zone_breps,
                            znames,
                            is_roof_adiabatic,
                            is_floor_adiabatic,
                            wwrs,
                            shades,
                            automated_shades,
                            glazing_type,
                            shgc,
                            custom_shades,
                            cladding,
                            exterior_insulation_material,
                            exterior_insulation_thickness,
                            interior_insulation_material,
                            exterior_wall_framing,
                            interior_finish,
                            city,
                            out_path,
                            run_model,
                            building_type,
                            num_floors_above,
                            composite_slab,
                            columns,
                            beams_x,
                            beams_y,
                            cores)
# ---------- end building ----------
panel_4 = Panel(building.out)
embodied = GhPythonScript(building=building.building)  # -> out, embodied_pie, total_embodied, embodied_ft2, building, envelope_report, slab_report, str_report
# ---------- embodied: Python ----------
__author__ = "tmendeze"

import rhinoscriptsyntax as rs

from carbon_tool.functions import pie_maker
reload(pie_maker)
from carbon_tool.functions.pie_maker import make_emb_pie

building.compute_structure_embodied()
building.compute_envelope_embodied()

embodied_pie, total_embodied, embodied_ft2 = make_emb_pie(building)

envelope_report = building.envelope.env_strings
slab_report = building.structure.slab_strings
str_report = [building.structure.beam_string]
str_report.append(building.structure.col_string)
# ---------- end embodied ----------
panel_5 = Panel(embodied.out)

draw_structure = GhPythonScript(building=embodied.building)  # -> out, slabs, columns, beams, cores
# ---------- draw_structure: Python ----------
__author__ = "tmendeze"

import rhinoscriptsyntax as rs

slabs, columns, beams, cores = building.draw_structure()
# ---------- end draw_structure ----------
brep_2 = Brep(draw_structure.slabs)
brep_3 = Brep(draw_structure.beams)
brep_4 = Brep(draw_structure.cores)

panel_6 = Panel(embodied.envelope_report)
panel_7 = Panel(embodied.slab_report)
panel_8 = Panel(embodied.str_report)
panel_9 = Panel(draw_structure.out)
pie = PieChart(embodied.embodied_pie)
brep_5 = Brep(draw_structure.columns)
kg_co2e_ft2 = Panel(embodied.embodied_ft2)
kg_co2e = Panel(embodied.total_embodied)
building_op_out = GhPythonScript(building=embodied.building)  # -> out, breps, znames, is_roof_adiabatic, is_floor_adiabatic, north_wwr, east_wwr, south_wwr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
# ---------- building_op_out: Python ----------
zone_breps                    = building.zone_breps                   
znames                        = building.znames                       
is_roof_adiabatic             = building.is_roof_adiabatic            
is_floor_adiabatic            = building.is_floor_adiabatic           
wwrs                          = building.wwrs                         
shades                        = building.shades
automated_shades              = building.automated_shades
glazing_u                     = building.glazing_u                    
shgc                          = building.shgc                         
custom_shades                 = building.custom_shades                
cladding                      = building.cladding                     
exterior_insulation_material  = building.exterior_insulation_material 
exterior_insulation_thickness = building.exterior_insulation_thickness
interior_insulation_material  = building.interior_insulation_material 
exterior_wall_framing         = building.exterior_wall_framing        
interior_finish               = building.interior_finish              
weather_file                  = building.weather_file                 
out_path                      = building.out_path                     
run_model                     = building.run_model                     

breps = [zone_breps[zname] for zname in building.znames]

north_wwr = wwrs['north']
east_wwr = wwrs['east']
south_wwr = wwrs['south']
west_wwr = wwrs['west']


north_horizontal_shade_depth = shades['north']['horizontal']['depth']
east_horizontal_shade_depth = shades['east']['horizontal']['depth']
south_horizontal_shade_depth = shades['south']['horizontal']['depth']
west_horizontal_shade_depth = shades['west']['horizontal']['depth']

north_horizontal_num_shades = shades['north']['horizontal']['num']
east_horizontal_num_shades = shades['east']['horizontal']['num']
south_horizontal_num_shades = shades['south']['horizontal']['num']
west_horizontal_num_shades = shades['west']['horizontal']['num']

north_vertical_shade_depth = shades['north']['vertical']['depth']
east_vertical_shade_depth = shades['east']['vertical']['depth']
south_vertical_shade_depth = shades['south']['vertical']['depth']
west_vertical_shade_depth = shades['west']['vertical']['depth']

north_vertical_num_shades = shades['north']['vertical']['num']
east_vertical_num_shades = shades['east']['vertical']['num']
south_vertical_num_shades = shades['south']['vertical']['num']
west_vertical_num_shades = shades['west']['vertical']['num']

north_automated_shades = automated_shades['north']
east_automated_shades = automated_shades['east']
south_automated_shades = automated_shades['south']
west_automated_shades = automated_shades['west']

shgc_n = shgc['north']
shgc_e = shgc['east']
shgc_s = shgc['south']
shgc_w = shgc['west']
# ---------- end building_op_out ----------

# ----
# Wall Construction
# Options
ext_insulation_thickness_in_2 = Slider(0, range=0..12)
int_insulation_2 = ValueList({"Fiberglass", "Cellulose", "None"}, selected=[])
interior_finish_2 = ValueList({"Gyp", "None"}, selected="Gyp")
ext_insulation_2 = ValueList({"EPS", "Polyiso", "Rockwool"}, selected="Polyiso")
facade_cladding_2 = ValueList({"Brick", "Fiber Cement", "Metal Panel": "Steel Panel", "Wood"}, selected="Fiber Cement")
exterior_wall_framing_2 = ValueList({"CLT", "Concrete", "2x4 Wood Studs", "2x6 Wood Studs", "2x8 Wood Studs", "2x10 Wood Studs", "2x12 Wood Studs"}, selected="2x6 Wood Studs")

weather_file = Panel(building_op_out.weather_file)
run_energy_model_2 = BooleanToggle(False)
folder_to_save_simulations_2 = Panel(building_op_out.out_path)

# ----
# Zone Names
panel_10 = Panel(building_op_out.znames)

exterior_shades_brep_2 = Brep(building_op_out.custom_shades)

# ----
# Inputs required
# for operational energy
# simulation
# Zone Geometry
brep_6 = Brep(building_op_out.breps)

# ----
# Facade Material
thickness_m = Panel("0.1016")  # disabled
conductivity_w_m_k = Panel("0.824")  # disabled
density_kg_m3 = Panel("1920")  # disabled
specific_heat_j_kg_k = Panel("790")  # disabled

# ----
# Exterior Insulation
r_per_inch_f_ft2_hr_btu_in = Panel("5")  # disabled
thickness_in = Panel("2")  # disabled

# ----
# Exterior Wall Framing
# For wood framed wall
# or
# For concrete or CLT
r_value_f_ft2_hr_btu = Panel("12.29")  # disabled
thickness_m_2 = Panel("0.0254")  # disabled
conductivity_w_m_k_2 = Panel("1.802")  # disabled
density_kg_m3_2 = Panel("2255")  # disabled
specific_heat_j_kg_k_2 = Panel("750")  # disabled

# ----
# Interior Finish
thickness_m_3 = Panel("0.0127")  # disabled
conductivity_w_m_k_3 = Panel("0.16")  # disabled
specific_heat_j_kg_k_3 = Panel("109")  # disabled
density_kg_m3_3 = Panel("800")  # disabled

# ----
# Operational Energy
# Simulatoin
# Facade Material
# Air Gap
# Exterior Insulation
# Exterior Wall Framing
# Facade Material
# Interior Finish
hb_climate_zones = HBClimateZones({"1 - Very Hot": "1", "2 - Hot": "2", "3 - Warm": "3", "4 - Mixed": "4", "5 - Cool": "5", "6 - Cold": "6", "7 - Very Cold": "7", "8 - Subarctic": "8"}, selected="4 - Mixed")  # disabled
panel_11 = Panel("WoodFramed")  # disabled
hb_building_programs = HBBuildingPrograms({"LargeOffice", "MediumOffice", "SmallOffice", "MidriseApartment", "HighriseApartment", "Retail", "StripMall", "PrimarySchool", "SecondarySchool", "SmallHotel", "LargeHotel", "Hospital", "Outpatient", "Laboratory", "Warehouse", "SuperMarket", "FullServiceRestaurant", "QuickServiceRestaurant", "Courthouse", "LargeDataCenterHighITE", "LargeDataCenterLowITE", "SmallDataCenterHighITE", "SmallDataCenterLowITE"}, selected="MidriseApartment")  # disabled
constrsetclimate = HBConstructionSetByClimate(climate_zone=hb_climate_zones, constr_type=panel_11)  # -> constr_set; disabled; plug-in component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
roomsolid = HBRoomFromSolid(geo=flatten(brep_6), name=panel_10, constr_set=constrsetclimate, program=hb_building_programs, conditioned=True)  # -> out, rooms; disabled; plug-in component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
boolean_toggle = BooleanToggle(True)  # disabled
solveadj = HBSolveAdjacency(rooms=flatten(roomsolid.rooms), run=boolean_toggle)  # -> out, adj_rooms; disabled; plug-in component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
adiabaticbytype = HBAdiabaticByType(
    hb_objs=flatten(solveadj.adj_rooms),
    roofs=building_op_out.is_roof_adiabatic,
    exposed_floors=building_op_out.is_floor_adiabatic)  # -> hb_objs; disabled; plug-in component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
facparam = HBFacadeParameters(
    north=building_op_out.north_wwr,
    east=building_op_out.east_wwr,
    south=building_op_out.south_wwr,
    west=building_op_out.west_wwr)  # -> fac_par; disabled; plug-in component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
multiplication = Multiplication(A=r_per_inch_f_ft2_hr_btu_in, B=thickness_in)  # disabled
panel_12 = Panel("h-ft2-F/Btu")  # disabled
panel_13 = Panel("m2-K/W")  # disabled
panel_14 = Panel("h-ft2-F/Btu")  # disabled
panel_15 = Panel("m2-K/W")  # disabled
panel_16 = Panel("exterior_insulatoin")  # disabled
units = LBUnitConverter(values=multiplication, from_u=panel_12, to_u=panel_13)  # -> all_u, values; disabled; plug-in component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
panel_17 = Panel("facade_material")  # disabled
aperturesbyratio = HBAperturesByRatio(hb_objs=flatten(adiabaticbytype), ratio=facparam)  # -> out, hb_objs; disabled; plug-in component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
panel_18 = Panel("generic wall gap")  # disabled
panel_19 = Panel("exterior_wall_framing")  # disabled
units_2 = LBUnitConverter(values=r_value_f_ft2_hr_btu, from_u=panel_14, to_u=panel_15)  # -> all_u, values; disabled; plug-in component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
panel_20 = Panel("exterior_wall_framing")  # disabled
panel_21 = Panel("interior_finish")  # disabled
panel_22 = Panel("Btu/h-ft2-F")  # disabled
facparam_2 = HBFacadeParameters(
    north=building_op_out.north_horizontal_shade_depth,
    east=building_op_out.east_horizontal_shade_depth,
    south=building_op_out.south_horizontal_shade_depth,
    west=building_op_out.west_horizontal_shade_depth)  # -> fac_par; disabled; plug-in component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
facparam_3 = HBFacadeParameters(
    north=building_op_out.north_horizontal_num_shades,
    east=building_op_out.east_horizontal_num_shades,
    south=building_op_out.south_horizontal_num_shades,
    west=building_op_out.west_horizontal_num_shades)  # -> fac_par; disabled; plug-in component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
opaquematnomass = HBOpaqueMaterialNoMass(name=panel_16, r_value=units.values)  # -> flatten(mat); disabled; plug-in component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
searchmats = HBSearchMaterials(keywords=panel_18)  # -> flatten(opaque_mats), window_mats; disabled; plug-in component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
panel_23 = Panel("W/m2-K")  # disabled
opaquemat = HBOpaqueMaterial(
    name=panel_17,
    thickness=thickness_m,
    conductivity=conductivity_w_m_k,
    density=density_kg_m3,
    spec_heat=specific_heat_j_kg_k)  # -> flatten(mat); disabled; plug-in component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
equality = Equality(FirstNumber=thickness_in, SecondNumber=0)  # -> Equality, Inequality; disabled
facparam_4 = HBFacadeParameters(north=building_op_out.shgc_n, east=building_op_out.shgc_e, south=building_op_out.shgc_s, west=building_op_out.shgc_w)  # -> fac_par; disabled; plug-in component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
units_3 = LBUnitConverter(values=building_op_out.glazing_u, from_u=panel_22, to_u=panel_23)  # -> all_u, values; disabled; plug-in component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
opaquemat_2 = HBOpaqueMaterial(
    name=panel_20,
    thickness=thickness_m_2,
    conductivity=conductivity_w_m_k_2,
    density=density_kg_m3_2,
    spec_heat=specific_heat_j_kg_k_2)  # -> flatten(mat); disabled; plug-in component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
opaquematnomass_2 = HBOpaqueMaterialNoMass(name=panel_19, r_value=units_2.values)  # -> flatten(mat); disabled; plug-in component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
opaquemat_3 = HBOpaqueMaterial(
    name=panel_21,
    thickness=thickness_m_3,
    conductivity=conductivity_w_m_k_3,
    density=density_kg_m3_3,
    spec_heat=specific_heat_j_kg_k_3)  # -> flatten(mat); disabled; plug-in component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
louvershades = HBLouverShades(hb_objs=flatten(aperturesbyratio.hb_objs), depth=facparam_2, shade_count=facparam_3)  # -> readMe, hb_objs; disabled; plug-in component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
stream_filter = StreamFilter(Gate=equality.Inequality, Stream1=opaquematnomass)  # -> flatten(Stream); disabled
windowmat = HBWindowMaterial(u_factor=units_3.values, shgc=graft(facparam_4))  # -> simplify(mat); disabled; plug-in component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
facparam_5 = HBFacadeParameters(
    north=building_op_out.north_vertical_shade_depth,
    east=building_op_out.east_vertical_shade_depth,
    south=building_op_out.south_vertical_shade_depth,
    west=building_op_out.west_vertical_shade_depth)  # -> fac_par; disabled; plug-in component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
facparam_6 = HBFacadeParameters(
    north=building_op_out.north_vertical_num_shades,
    east=building_op_out.east_vertical_num_shades,
    south=building_op_out.south_vertical_num_shades,
    west=building_op_out.west_vertical_num_shades)  # -> fac_par; disabled; plug-in component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
boolean_toggle_2 = BooleanToggle(True)  # disabled
stream_filter_2 = StreamFilter(Gate=0, Stream0=opaquematnomass_2, Stream1=opaquemat_2)  # disabled
windowconstr = HBWindowConstruction(materials=windowmat)  # -> constr; disabled; plug-in component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
thickness_shade_m = Slider(0.0008, range=0..0.001)  # disabled
transmittance = Slider(0.1, range=0..0.1)  # disabled
louvershades_2 = HBLouverShades(hb_objs=flatten(louvershades.hb_objs), depth=facparam_5, shade_count=facparam_6, vertical=boolean_toggle_2)  # -> readMe, hb_objs; disabled; plug-in component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
w_m2_for_exterior_shade_deployment = Slider(25, range=0..100)  # disabled
control_type = Slider(1, range=0..1)  # disabled
facparam_7 = HBFacadeParameters(
    north=building_op_out.north_vertical_shade_depth,
    east=building_op_out.east_vertical_shade_depth,
    south=building_op_out.south_vertical_shade_depth,
    west=building_op_out.west_vertical_shade_depth)  # -> fac_par; disabled; plug-in component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
shademat = HBShadeMaterial(thickness=thickness_shade_m, transmittance=transmittance)  # -> mat; disabled; plug-in component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
panel_24 = Panel("Exterior")  # disabled
boolean_toggle_3 = BooleanToggle(True)  # disabled
windowconstrshd = HBWindowConstructionShade(
    win_constr=windowconstr,
    shd_material=shademat,
    shd_location=panel_24,
    control_type=control_type,
    setpoint=w_m2_for_exterior_shade_deployment)  # -> constr; disabled; plug-in component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
opaqueconstr = HBOpaqueConstruction(materials=[opaquemat, searchmats.opaque_mats, stream_filter, stream_filter_2, opaquemat_3])  # -> constr; disabled; plug-in component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
explode_tree = ExplodeTree(Data=windowconstr)  # -> Branch0, Branch1, Branch2, Branch3; disabled
louvershades_3 = HBLouverShades(hb_objs=flatten(louvershades_2.hb_objs), depth=facparam_7, vertical=boolean_toggle_3, flip_start=boolean_toggle_3)  # -> readMe, hb_objs; disabled; plug-in component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
explode_tree_2 = ExplodeTree(Data=windowconstrshd)  # -> Branch0, Branch1, Branch2, Branch3; disabled
panel_25 = Panel(opaqueconstr)  # disabled
stream_filter_3 = StreamFilter(Gate=building_op_out.south_automated_shades, Stream0=explode_tree.Branch2, Stream1=explode_tree_2.Branch2)  # disabled
stream_filter_4 = StreamFilter(Gate=building_op_out.east_automated_shades, Stream0=explode_tree.Branch1, Stream1=explode_tree_2.Branch1)  # disabled
stream_filter_5 = StreamFilter(Gate=building_op_out.north_automated_shades, Stream0=explode_tree.Branch0, Stream1=explode_tree_2.Branch0)  # disabled
stream_filter_6 = StreamFilter(Gate=building_op_out.west_automated_shades, Stream0=explode_tree.Branch3, Stream1=explode_tree_2.Branch3)  # disabled
facparam_8 = HBFacadeParameters(north=stream_filter_5, east=stream_filter_4, south=stream_filter_3, west=stream_filter_6)  # -> fac_par; disabled; plug-in component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
applywindowconstr = HBApplyWindowConstruction(hb_objs=flatten(louvershades_3.hb_objs), constr=facparam_8)  # -> hb_objs; disabled; plug-in component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
applyopaqueconstr = HBApplyOpaqueConstruction(hb_objs=flatten(applywindowconstr), constr=opaqueconstr)  # -> hb_objs; disabled; plug-in component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
number_slider = Slider(500, range=0..1000)  # disabled
shade = HBShade(geo=exterior_shades_brep_2)  # -> out, shades; disabled; plug-in component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
daylightcontrol = HBApplyDaylightControl(rooms=flatten(applyopaqueconstr), ill_setpoint=number_slider)  # -> out, rooms; disabled; plug-in component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
null_item = NullItem(Item=shade.shades)  # -> NullFlags, InvalidFlags, Description; disabled
list_item = ListItem(List=null_item.NullFlags, Index=0, Wrap=True)  # disabled
stream_filter_7 = StreamFilter(Gate=list_item, Stream0=shade.shades)  # disabled
model = HBModel(rooms=flatten(daylightcontrol.rooms), shades=flatten(stream_filter_7))  # -> out, model; disabled; plug-in component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
modeltoosm = HBModelToOSM(
    model=model.model,
    epw_file=weather_file,
    folder=folder_to_save_simulations_2,
    write=building_op_out.run_model,
    run=building_op_out.run_model)  # -> out, jsons, osw, osm, idf, sql, zsz, rdd, html; disabled; plug-in component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
vizbytype = HBVisualizeByType(hb_objs=model.model)  # -> walls, interior_walls, roofs, ceilings, exterior_floors, interior_floors, air_walls, apertures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; disabled; plug-in component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
